# Grasshopper definition circlecleanTESTINGMOVING.gh (Grasshopper 1.0.8)
# plug-ins: RhinoCodePluginGH, Pufferfish, Human

panel = Panel("""30
-15
15
15
-30
15
-15
15
-15
30
-15
15""")
twist = Panel("""30
60
-60
15
15
15
-15
-15
-15
-15
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""")
lng = ListLength(List=panel)
lift = Panel("""30
-15
15
15
-30
15
-15
15
-15
30
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""")
series = Series(Start="35", Step=-1, Count=lng)
series_2 = Series(Start=0, Step=1, Count=lng)
replace = ReplaceItems(
    List=["0", "0", "0", "0", "0", "0", "0", "0", "0", "0", "0", "0", "0", "0", "0", "0", "0", "0", "0", "0", "0", "0", "0", "0", "0", "0", "0", "0", "0", "0", "0", "0", "0", "0", "0", "0"],
    Item=panel,
    Indices=series_2,
    Wrap=False)
neg = Negative(Value=panel)
replace_2 = ReplaceItems(List=replace, Item=neg, Indices=series, Wrap=False)
equals = Equality(FirstNumber=replace_2, SecondNumber="0")  # -> Equality, Inequality
invbool = InvertBoolean(Boolean=equals.Equality)  # -> Inverted, Number
int = Integer(invbool.Inverted)

data = Data(int)
data_2 = Data(replace_2)

ipy2 = IronPython2Script(toggles=data, angles=data_2)  # -> out, output; inputs toggles: list, angles: list of Int32
# ---------- ipy2: IronPython ----------
import json

angleObjects = []
for index in range(len(toggles)):
    angleObjects.append({"toggle":toggles[index], "angle": angles[index]})
    print(angleObjects)

output = json.dumps( {"type":"angles", "angles":angleObjects})
# ---------- end ipy2 ----------
ipy2_2 = IronPython2Script(inJson=ipy2.output)  # -> out, t, a; inputs inJson: String
# ---------- ipy2_2: IronPython ----------
import json

data = json.loads(inJson)

tBuffer = []
aBuffer = []

for d in data["angles"]:
    tBuffer.append(d["toggle"])
    aBuffer.append(d["angle"])

t = tBuffer
a = aBuffer
# ---------- end ipy2_2 ----------
data_3 = Data(ipy2_2.t)
data_4 = Data(ipy2_2.a)

panel_2 = Panel(ipy2.output)
cluster = Cluster_2(toggle=data_3, angle=data_4)  # -> mesh_3, angle_2, angle_00, V
data_5 = Data(cluster.mesh_3)
medges = MeshEdges(Mesh=data_5)  # -> NakedEdges, InteriorEdges, NonManifoldEdges
line = Line(medges.InteriorEdges)
remapper = ListItem(List=line, Index=[0, 2, 3, 4, 5, 6, 7, 8, 9, 10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], Wrap=True)
crv = Curve(remapper)
cull = CullPattern(List=crv, CullPattern=invert(data))
cull_2 = CullPattern(List=crv, CullPattern=data)
line_2 = Line(remapper)
midpt = CurveMiddle(Curve=line_2)
lng_2 = ListLength(List=midpt)
series_3 = Series(Start=0, Step=1, Count=lng_2)
xz = XZPlane(Origin=midpt)
data_6 = Data(cluster.angle_2)
data_7 = Data(cluster.angle_00)
tag = TextTag(Location=xz, Text=series_3, Colour=ColourSwatch(SwatchColor=RGB(0, 157, 255)))
data_8 = Data(cluster.V)
previewlw = CustomPreviewLineweights(Geometry=cull_2, Shader=ColourSwatch(SwatchColor=RGB(0, 0, 0)), Thickness="2", Absolute=False)
previewlw_2 = CustomPreviewLineweights(Geometry=cull, Shader=ColourSwatch(SwatchColor=RGB(0, 214, 11)), Thickness="2", Absolute=False)

# ==== cluster Cluster_2
toggle = ClusterInput()
angle = ClusterInput()
_10º = PowerOf10(Value=Slider(5, range=1..9))
circlemaker = CircleMaker(A="36", B="36", R="975", A_2="1250")  # -> L, S, P

pt = Point(circlemaker.L)
crv = Curve(circlemaker.S)
pt_2 = Point(circlemaker.P)

meshmaker = MeshMaker(_0=pt, _1=pt_2, int="36")
mesh = Mesh(meshmaker)
cluster = Cluster(data=toggle, data_2=angle, mesh=mesh, int="36", int_2=_10º)  # -> mesh_3, data_6
solver = Solver(goalobjects=cluster.data_6)

# ---- group: RH:OUTMESH
mesh_2 = Mesh(solver)

# ----
mesh_3 = ClusterOutput(mesh_2)
angle_calculator = Angle_calculator(int="36", mesh=mesh_2)  # -> angle_3, angle_00_2
angle_2 = ClusterOutput(angle_calculator.angle_3)
angle_00 = ClusterOutput(angle_calculator.angle_00_2)
demesh = DeconstructMesh(Mesh=mesh_2)  # -> Vertices, Faces, Colours, Normals
V = ClusterOutput(demesh.Vertices)

# ==== cluster CircleMaker
pt = ConstructPoint(XCoordinate=0, YCoordinate=0, ZCoordinate=0)
xz = XZPlane(Origin=pt)
A = ClusterInput()
pflip = FlipPlane(Plane=xz, ReverseX=False, ReverseY=False, SwapAxes=True)
division = Division(A=A, B=2)
B = ClusterInput()
division_2 = Division(A="360", B=B)
rad = Radians(Degrees=division_2)
cos = Cosine(Value=rad)
A_2 = ClusterInput()
prot = RotatePlane(Plane=pflip, Angle=degrees(division_2))
R = ClusterInput()
division_3 = Division(A=A_2, B=cos)
cir = Circle(Plane=pflip, Radius=R)
cir_2 = Circle(Plane=prot, Radius=division_3)
divide = DivideCurve(Curve=cir, Count=division, Kinks=False)  # -> Points, Tangents, Parameters
shift = ShiftList(List=divide.Points, Shift=1, Wrap=True)
divide_2 = DivideCurve(Curve=cir_2, Count=division, Kinks=False)  # -> Points, Tangents, Parameters
L = ClusterOutput(shift)
P = ClusterOutput(divide_2.Points)
weave = Weave(Pattern=[0, 1], Stream0=divide_2.Points, Stream1=shift, NullGaps=False)
pline = PolyLine(Vertices=weave, Closed=True)
explode = Explode(Curve=pline, Recursive=True)  # -> Segments, Vertices
S = ClusterOutput(explode.Segments)

# ==== cluster MeshMaker
int = ClusterInput()
int_2 = Integer(int)
_0 = ClusterInput()
_1 = ClusterInput()
series = Series(Start=0, Step=1, Count=int_2)
weave = Weave(Pattern=[1, 0], Stream0=_0, Stream1=_1, NullGaps=False)
shift = ShiftList(List=weave, Shift=-1, Wrap=True)
addition = Addition(A=series, B=2)
addition_2 = Addition(A=series, B=1)
mod = Modulus(A=addition, B=int_2)
mod_2 = Modulus(A=addition_2, B=int_2)
mod_3 = Modulus(A=series, B=int_2)
concat = Concatenate(FragmentA="Q{", FragmentB=mod_3, FragmentC=";", FragmentD=mod_2, FragmentE=";", FragmentF=mod, FragmentG="}")
conmesh = ConstructMesh(Vertices=shift, Faces=concat)
unim = UnifyMesh(Mesh=conmesh)  # -> Result, Count
R = ClusterOutput(unim.Result)

# ==== cluster Cluster
int = ClusterInput()
int_2 = ClusterInput()
data = ClusterInput()
mesh = ClusterInput()
int_3 = Integer(int)
data_2 = ClusterInput()
int_4 = Integer(int_2)
data_3 = Data(data)
mesh_2 = Mesh(mesh)
data_4 = Data(data_2)
mesh_3 = ClusterOutput(mesh_2)
series = Series(Start=0, Step=1, Count=int_3)
addition = Addition(A=series, B=1)

demesh = DeconstructMesh(Mesh=mesh_2)  # -> Vertices, Faces, Colours, Normals
item = ListItem(List=demesh.Vertices, Index=0, Wrap=True)  # -> Item2, Item1, Item, Item1_2
anchor = Anchor(Point=[item.Item1, item.Item1_2], Strength=int_4)

demesh_2 = DeconstructMesh(Mesh=mesh_2)  # -> Vertices, Faces, Colours, Normals
mod = Modulus(A=addition, B=int_3)
mod_2 = Modulus(A=series, B=int_3)
shift = ShiftList(List=mod_2, Shift=-1, Wrap=True)
shift_2 = ShiftList(List=mod_2, Shift=2, Wrap=True)
equals = Equality(FirstNumber=data_3, SecondNumber=0)  # -> Equality, Inequality
edgelengths = EdgeLengths(Mesh=mesh_2, LengthFactor=1, Strength=int_4)
item_2 = ListItem(List=demesh_2.Vertices, Index=mod_2, Wrap=True)
show = Show(G=mesh_2)
item_3 = ListItem(List=demesh_2.Vertices, Index=mod, Wrap=True)
item_4 = ListItem(List=demesh_2.Vertices, Index=shift, Wrap=True)
item_5 = ListItem(List=demesh_2.Vertices, Index=shift_2, Wrap=True)
cull = CullPattern(List=data_4, CullPattern=equals.Inequality)
cull_2 = CullPattern(List=series, CullPattern=data_3)
rad = Radians(Degrees=cull)
nofoldthrough = NoFoldThrough(FoldStart=item_2, FoldEnd=item_3, Tip1=item_4, Tip2=item_5, Strength=int_4)
item_6 = ListItem(List=item_2, Index=cull_2, Wrap=True)
item_7 = ListItem(List=item_3, Index=cull_2, Wrap=True)
item_8 = ListItem(List=item_4, Index=cull_2, Wrap=True)
item_9 = ListItem(List=item_5, Index=cull_2, Wrap=True)
hinge = Hinge(FoldStart=item_6, FoldEnd=item_7, Tip1=item_8, Tip2=item_9, RestAngle=rad, Strength=int_4)
data_5 = Data(flatten([show, anchor, edgelengths, nofoldthrough, hinge]))
data_6 = ClusterOutput(data_5)

# ==== cluster Angle_calculator
int = ClusterInput()
mesh = ClusterInput()
int_2 = Integer(int)
mesh_2 = Mesh(mesh)
series = Series(Start=0, Step=1, Count=int_2)
addition = Addition(A=series, B=1)
facen = FaceNormals(Mesh=mesh_2)  # -> Centers, Normals
mod = Modulus(A=addition, B=int_2)
mod_2 = Modulus(A=series, B=int_2)
item = ListItem(List=facen.Normals, Index=mod_2, Wrap=True)
item_2 = ListItem(List=facen.Normals, Index=mod, Wrap=True)
item_3 = ListItem(List=facen.Centers, Index=mod, Wrap=True)
item_4 = ListItem(List=facen.Centers, Index=mod_2, Wrap=True)
amp = Amplitude(Vector=item, Amplitude="100")
amp_2 = Amplitude(Vector=item_2, Amplitude="100")
addition_2 = Addition(A=item_4, B=amp)
addition_3 = Addition(A=item_3, B=amp_2)
angle = Angle(VectorA=item, VectorB=item_2)  # -> Angle, Reflex
vec2pt = Vector2Pt(PointA=item_4, PointB=item_3, Unitize=False)  # -> Vector, Length
vec2pt_2 = Vector2Pt(PointA=addition_2, PointB=addition_3, Unitize=False)  # -> Vector, Length
larger = LargerThan(FirstNumber=vec2pt.Length, SecondNumber=vec2pt_2.Length)  # -> LargerThan, OrEqualTo
sift = SiftPattern(List=angle.Angle, SiftPattern=larger.LargerThan)  # -> Output0, Output1
neg = Negative(Value=sift.Output1)
combine = CombineData(Input0=sift.Output0, Input1=neg)  # -> Result, Index
deg = Degrees(Radians=combine.Result)
shift = ShiftList(List=deg, Shift=-1, Wrap=True)
multiplication = Multiplication(A=shift, B="100")
int_3 = Integer(multiplication)
division = Division(A=int_3, B="100")
angle_2 = Data(shift)
angle_00 = Data(division)
angle_3 = ClusterOutput(angle_2)
angle_00_2 = ClusterOutput(angle_00)

# ==== cluster Solver
goalobjects = ClusterInput()
zombiesolver = ZombieSolver(GoalObjects=goalobjects, Threshold=1e-10, Tolerance=0.0001, MaxIterations=50000)  # -> I, V, O
item = ListItem(List=zombiesolver.O, Index=0, Wrap=True)
mesh = Mesh(item)
mesh_2 = ClusterOutput(mesh)
