# Grasshopper definition compute.gh (Grasshopper 1.0.8)
# plug-ins: RhinoCodePluginGH, Heteroptera, Pufferfish, ghWebSocket Info

websocket_client = WebSocketClient(Host="localhost", Port="8001", Interval="100")  # -> Socket, Message
event = EventGate(Data=websocket_client.Message)  # -> Data, IsNew
websocket_state = WebSocketState(Socket=websocket_client.Socket)
panel = Panel(event.Data)
panel_2 = Panel(websocket_state)

# ---- group: login
panel_4 = Panel("""{
  "type": "login",
  "client": "gh"
}""")
eval = Evaluate(F="if(x=\"Open\",1,0)", x=websocket_state)
invbool = InvertBoolean(Boolean=eval)  # -> Inverted, Number
freeze_gate = StreamFreezeGate(Data=panel_4, PassingSwitch=eval, Freeze=False)
websocket_send = WebSocketSend(Socket=websocket_client.Socket, Message=freeze_gate, Broadcast=invbool.Inverted, ForceSend=False)

# ----
ipy2 = IronPython2Script(inJson=event.Data)  # -> out, t, a; inputs inJson: String
# ---------- ipy2: IronPython ----------
import json

data = json.loads(inJson)

tBuffer = []
aBuffer = []

for d in data["angles"]:
    tBuffer.append(d["toggle"])
    aBuffer.append(d["angle"])

t = tBuffer
a = aBuffer
# ---------- end ipy2 ----------
data = Data(ipy2.t)
data_2 = Data(ipy2.a)
compute = Compute(toggle=data, angle=data_2)  # -> angle_2, angle_00, V
scale = Scale(Geometry=compute.V, Center=Point(0, 0, 0), Factor="0.0005")  # -> Geometry, Transform
data_3 = Data(compute.angle_2)
data_4 = Data(compute.angle_00)
pdecon = Deconstruct(Point=scale.Geometry)  # -> XComponent, YComponent, ZComponent
pt = ConstructPoint(XCoordinate=pdecon.XComponent, YCoordinate=pdecon.ZComponent, ZCoordinate=pdecon.YComponent)
ipy2_2 = IronPython2Script(positions=pt)  # -> out, output; inputs positions: list of Point3d
# ---------- ipy2_2: IronPython ----------
import json
import Rhino.Geometry as rg


flat_pos = []
print(positions)
for point in positions:
    print(point)
    flat_pos.append(point.X)
    flat_pos.append(point.Y)
    flat_pos.append(point.Z)


output = json.dumps( {"type":"positions", "positions":flat_pos})
# ---------- end ipy2_2 ----------
ipy2_3 = IronPython2Script(toggles=data, angles=data_3)  # -> out, output; inputs toggles: list, angles: list
# ---------- ipy2_3: IronPython ----------
import json

angleObjects = []
for index in range(len(toggles)):
    angleObjects.append({"t":toggles[index], "gA": angles[index]})

output = json.dumps( {"type":"angles", "angles":angleObjects})
# ---------- end ipy2_3 ----------
websocket_send_2 = WebSocketSend(Socket=websocket_client.Socket, Message=ipy2_2.output, Broadcast=False, ForceSend=False)
websocket_send_3 = WebSocketSend(Socket=websocket_client.Socket, Message=ipy2_3.output, Broadcast=False, ForceSend=False)
panel_5 = Panel(websocket_send_3)
panel_6 = Panel(websocket_send_2)

# ==== cluster Compute
_10º = PowerOf10(Value=Slider(5, range=1..9))
mesh = Mesh(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)
toggle = ClusterInput()
angle = ClusterInput()
cluster = Cluster(data=toggle, data_2=angle, mesh=mesh, int="36", int_2=_10º)  # -> mesh_3, data_6
solver = Solver(goalobjects=cluster.data_6)

# ---- group: RH:OUTMESH
mesh_2 = Mesh(solver)

# ----
angle_calculator = Angle_calculator(int="36", mesh=mesh_2)  # -> angle_3, angle_00_2
demesh = DeconstructMesh(Mesh=mesh_2)  # -> Vertices, Faces, Colours, Normals
V = ClusterOutput(demesh.Vertices)
angle_2 = ClusterOutput(angle_calculator.angle_3)
angle_00 = ClusterOutput(angle_calculator.angle_00_2)

# ==== cluster Cluster
int = ClusterInput()
int_2 = ClusterInput()
data = ClusterInput()
mesh = ClusterInput()
int_3 = Integer(int)
data_2 = ClusterInput()
int_4 = Integer(int_2)
data_3 = Data(data)
mesh_2 = Mesh(mesh)
data_4 = Data(data_2)
mesh_3 = ClusterOutput(mesh_2)
series = Series(Start=0, Step=1, Count=int_3)
addition = Addition(A=series, B=1)

demesh = DeconstructMesh(Mesh=mesh_2)  # -> Vertices, Faces, Colours, Normals
item = ListItem(List=demesh.Vertices, Index=0, Wrap=True)  # -> Item2, Item1, Item
anchor = Anchor(Point=[item.Item, item.Item2], Strength=int_4)

demesh_2 = DeconstructMesh(Mesh=mesh_2)  # -> Vertices, Faces, Colours, Normals
mod = Modulus(A=addition, B=int_3)
mod_2 = Modulus(A=series, B=int_3)
shift = ShiftList(List=mod_2, Shift=-1, Wrap=True)
shift_2 = ShiftList(List=mod_2, Shift=2, Wrap=True)
equals = Equality(FirstNumber=data_3, SecondNumber=0)  # -> Equality, Inequality
edgelengths = EdgeLengths(Mesh=mesh_2, LengthFactor=1, Strength=int_4)
item_2 = ListItem(List=demesh_2.Vertices, Index=mod_2, Wrap=True)
show = Show(G=mesh_2)
item_3 = ListItem(List=demesh_2.Vertices, Index=mod, Wrap=True)
item_4 = ListItem(List=demesh_2.Vertices, Index=shift, Wrap=True)
item_5 = ListItem(List=demesh_2.Vertices, Index=shift_2, Wrap=True)
cull = CullPattern(List=data_4, CullPattern=equals.Inequality)
cull_2 = CullPattern(List=series, CullPattern=data_3)
rad = Radians(Degrees=cull)
nofoldthrough = NoFoldThrough(FoldStart=item_2, FoldEnd=item_3, Tip1=item_4, Tip2=item_5, Strength=int_4)
item_6 = ListItem(List=item_2, Index=cull_2, Wrap=True)
item_7 = ListItem(List=item_3, Index=cull_2, Wrap=True)
item_8 = ListItem(List=item_4, Index=cull_2, Wrap=True)
item_9 = ListItem(List=item_5, Index=cull_2, Wrap=True)
hinge = Hinge(FoldStart=item_6, FoldEnd=item_7, Tip1=item_8, Tip2=item_9, RestAngle=rad, Strength=int_4)
data_5 = Data(flatten([show, anchor, edgelengths, nofoldthrough, hinge]))
data_6 = ClusterOutput(data_5)

# ==== cluster Angle_calculator
int = ClusterInput()
mesh = ClusterInput()
int_2 = Integer(int)
mesh_2 = Mesh(mesh)
series = Series(Start=0, Step=1, Count=int_2)
addition = Addition(A=series, B=1)
facen = FaceNormals(Mesh=mesh_2)  # -> Centers, Normals
mod = Modulus(A=addition, B=int_2)
mod_2 = Modulus(A=series, B=int_2)
item = ListItem(List=facen.Normals, Index=mod_2, Wrap=True)
item_2 = ListItem(List=facen.Normals, Index=mod, Wrap=True)
item_3 = ListItem(List=facen.Centers, Index=mod, Wrap=True)
item_4 = ListItem(List=facen.Centers, Index=mod_2, Wrap=True)
amp = Amplitude(Vector=item, Amplitude="100")
amp_2 = Amplitude(Vector=item_2, Amplitude="100")
addition_2 = Addition(A=item_4, B=amp)
addition_3 = Addition(A=item_3, B=amp_2)
angle = Angle(VectorA=item, VectorB=item_2)  # -> Angle, Reflex
vec2pt = Vector2Pt(PointA=item_4, PointB=item_3, Unitize=False)  # -> Vector, Length
vec2pt_2 = Vector2Pt(PointA=addition_2, PointB=addition_3, Unitize=False)  # -> Vector, Length
larger = LargerThan(FirstNumber=vec2pt.Length, SecondNumber=vec2pt_2.Length)  # -> LargerThan, OrEqualTo
sift = SiftPattern(List=angle.Angle, SiftPattern=larger.LargerThan)  # -> Output0, Output1
neg = Negative(Value=sift.Output1)
combine = CombineData(Input0=sift.Output0, Input1=neg)  # -> Result, Index
deg = Degrees(Radians=combine.Result)
shift = ShiftList(List=deg, Shift=-1, Wrap=True)
multiplication = Multiplication(A=shift, B="100")
int_3 = Integer(multiplication)
division = Division(A=int_3, B="100")
angle_2 = Data(shift)
angle_00 = Data(division)
angle_3 = ClusterOutput(angle_2)
angle_00_2 = ClusterOutput(angle_00)

# ==== cluster Solver
goalobjects = ClusterInput()
zombiesolver = ZombieSolver(GoalObjects=goalobjects, Threshold=1e-10, Tolerance=0.0001, MaxIterations=50000)  # -> I, V, O
item = ListItem(List=zombiesolver.O, Index=0, Wrap=True)
mesh = Mesh(item)
mesh_2 = ClusterOutput(mesh)
