# Grasshopper definition socket.gh (Grasshopper 1.0.8)
# plug-ins: jSwan, RhinoCodePluginGH, ghWebSocket Info

trigger = Trigger(Interval=1000, TimerInterval=1000, Target=websocket_client)
websocket_client = WebSocketClient(Host="localhost", Port="8001", Interval="1000")  # -> Socket, Message
websocket_receive = WebSocketReceive(Socket=websocket_client.Socket)
panel = Panel(websocket_receive)
websocket_state = WebSocketState(Socket=websocket_client.Socket)
websocket_state_2 = WebSocketState(Socket=websocket_client.Socket)
panel_2 = Panel(websocket_state)
panel_3 = Panel(websocket_state_2)
rejson = SerializeJson(IncludeNullAndEmptyProperties=False)
data = Data("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")
ipy2 = IronPython2Script(x=websocket_state_2)  # -> out, a
# ---------- ipy2: IronPython ----------
if x == "Open":
    a = 0
else:
    a = 1
# ---------- end ipy2 ----------
rejson_2 = SerializeJson(Type="login", Client="interface", IncludeNullAndEmptyProperties=False)
rejson_3 = SerializeJson(Type="login", Client="gh", IncludeNullAndEmptyProperties=False)
websocket_send = WebSocketSend(Socket=websocket_client.Socket, Message=data, Broadcast=False, ForceSend=False)
panel_5 = Panel(rejson_2)
websocket_send_2 = WebSocketSend(Socket=websocket_client.Socket, Message=rejson_3, Broadcast=ipy2.a, ForceSend=False)
